% Simulink data dictionary G474_FOC_LADRC.sldd

TsBSP = Simulink.Parameter(2.5e-5)  % 10kHz*4
TsBSP_MODEL = Simulink.Parameter(2.5e-5)  % 模型采样时间等参数的设置，用来避免fixed point工具的更改导致无法仿真。
TsFOC_MODEL = Simulink.Parameter(0.0001)  % 模型采样时间等参数的设置，用来避免fixed point工具的更改导致无法仿真。
TsFOC = Simulink.Parameter(0.0001)  % 10kHz
PWMHalfPeriod = Simulink.Parameter(4199)  % 定时器中央对齐，PWM输出最大比较值
PWMHalfPeriod_MODEL = Simulink.Parameter(4199)
PolePairs = Simulink.Parameter(5)
PolePairs_MODEL = Simulink.Parameter(5)  % 电机本体模型参数的设置，不支持定点数据。
Flux = Simulink.Parameter(0.0109)
Flux_MODEL = Simulink.Parameter(0.0109)  % 电机本体模型参数的设置，不支持定点数据。
Rs_MODEL = Simulink.Parameter(0.1763)  % 电机本体模型参数的设置，不支持定点数据。
Rs = Simulink.Parameter(0.1763)
Ls_MODEL = Simulink.Parameter(0.000195185)  % 电机本体模型参数的设置，不支持定点数据。
Ls = Simulink.Parameter(0.000195185)
MaxVoltage = Simulink.Parameter(10)
ObserverTheta = Simulink.Signal(StorageClass="Struct", StructName="ObserverParam")
ObserverRPM = Simulink.Signal(StorageClass="Struct", StructName="ObserverParam")
RefRPM = Simulink.Signal(StorageClass="Struct", StructName="ObserverParam")
BandwidthCurrentPI = Simulink.Parameter(1256.637)
RefIq = Simulink.Signal(StorageClass="Struct", StructName="ObserverParam")
LADRC_Omega_c = Simulink.Parameter(150, StorageClass="Struct", StructName="MotorParam")
LADRC_b0 = Simulink.Parameter(8000, StorageClass="Struct", StructName="MotorParam")
Gamma = Simulink.Parameter(500000, StorageClass="Struct", StructName="MotorParam")
pll_xi = Simulink.Parameter(10, StorageClass="Struct", StructName="MotorParam")
pll_omega = Simulink.Parameter(5000, StorageClass="Struct", StructName="MotorParam")